# Grasshopper definition Example.gh (Grasshopper 1.0.7)
# plug-ins: TJADSZY

panel = Panel("""出站地道
架空换乘区
高架层底面吊顶
铁路停车场
室外平台
站房部分""")
panel_2 = Panel("""装修区域
房间
分部分项工程
明细
单位
正式工程量
工程量""")
path = FilePath("D:\000SZY\99_Other\02Study\10CforGH\02GHPlugin\TJADSZY\test.xlsx")
number_slider = Slider(1, range=0..1)
nickname = TJADSZY(
    Run=Toggle(False),
    FilePath=path,
    StartCellIndex="A1",
    TitleNames=panel_2,
    WorkSheetNames=panel,
    ModGlassWall=number_slider,
    ModOtherWall=number_slider,
    ModCeiling=number_slider,
    ModCeilingSide=number_slider,
    ModForDM=number_slider,
    ModHandles=number_slider)
panel_3 = Panel(nickname)
