# Grasshopper definition example.gh (Grasshopper 1.0.7)
# plug-ins: TJADSZY

prompt = Panel("")
negative_prompt = Panel("")
num = Slider(5, range=0..10)
width = Slider(1024, range=200..1200)
height = Slider(512, range=200..1000)
model_name = ValueList({"architecturerealmix": "architecturerealmix_v11.safetensors", "revAnimated": "revAnimatedV1.2.2.safetensors", "architectureExterior": "architectureExterior_v40Exterior.safetensors"}, selected="architecturerealmix")
lora_model = ValueList({"must check": " ", "火车站": "<lora:station:1.2>", "zaha": "<lora:zaha:0.3>", "黄昏夜景": "<lora:GJHHYJYB01:1>", "鸟瞰图": "<lora:20_a:1>", "冬季": "<lora:snwvrch:1>", "curved ARCH": "<lora:curved_architecture:1>", "住宅立面": "<lora:house_architecture_Exterior_SDlife_Chiasedamme:1>"}, selected="must check")
nick_name = Panel("songziyu")
view_name = Panel("111")
path = FilePath("C:\Users\songziyu\Desktop\11.png")

框线控制 = BooleanToggle(True)
材质控制 = BooleanToggle(True)
run = BooleanToggle(False)
merge = Merge(Data1=框线控制, Data2=材质控制)
config = Configuration(
    Input_active_or_not=run,
    Input_base_model=model_name,
    Input_prompt=prompt,
    Input_negative_prompt=negative_prompt,
    Input_lora=lora_model,
    Input_image_number=num,
    Input_image_width=width,
    Input_image_height=height,
    Input_nickname=nick_name,
    Input_controlnet_or_not=merge,
    Input_namedView=view_name,
    Input_file_path=path)
render = PosttoRender(Send=run, BODY=config)
geturl = GetURL(Response=render)
item = ListItem(List=flatten(geturl), Index=Slider(0, range=0..10), Wrap=True)
panel = Panel(item)
image_resource = ImageResource(item)
