# Grasshopper definition Temp.gh (Grasshopper 1.0.7)
# plug-ins: RhinoCodePluginGH, TJADSZY

number_slider = Slider(8, range=0..10)
number_slider_2 = Slider(7, range=0..10)
number_slider_3 = Slider(4, range=0..10)
crv = Curve(<curve referenced from the Rhino model>)
cp = ControlPoints(Curve=crv)  # -> Points, Weights, Knots
area = Area(Geometry=crv)  # -> Area, Centroid
box = CenterBox(Base=PlaneXY(0, 0, 0), X=number_slider, Y=number_slider_2, Z=number_slider_3)
cull_i = CullIndex(List=cp.Points, Indices=-1, Wrap=True)
cir = Circle(Plane=PlaneXY(0, 0, 0), Radius=1)
number_slider_4 = Slider(1, range=0..1)
alongcrv = SortAlongCurve(Points=cull_i, Curve=cir)  # -> Points, Indices
crv_2 = Curve([<curve referenced from the Rhino model> x71])
crv_3 = Curve([<curve referenced from the Rhino model> x45])
crv_4 = Curve([<curve referenced from the Rhino model> x35])
S = Script(x=<missing>, y=number_slider, z=number_slider_2, u=number_slider_3)  # -> out, a; inputs x: Plane, y: Double, z: Double, u: Double
# ---------- S: C# ----------
// Grasshopper Script Instance
using System;
using System.Collections;
using System.Collections.Generic;
using System.Drawing;

using Rhino;
using Rhino.Geometry;

using Grasshopper;
using Grasshopper.Kernel;
using Grasshopper.Kernel.Data;
using Grasshopper.Kernel.Types;
using Rhino.NodeInCode;
using System.Linq;

public class Script_Instance : GH_ScriptInstance
{
  /* 
    Members:
      RhinoDoc RhinoDocument
      GH_Document GrasshopperDocument
      IGH_Component Component
      int Iteration

    Methods (Virtual & overridable):
      Print(string text)
      Print(string format, params object[] args)
      Reflect(object obj)
      Reflect(object obj, string method_name)
  */
  
  private void RunScript(Plane x, double y, double z, double u, out object a)
  {
    //var polyline=Components.FindComponent("PolyLine").Delegate as dynamic;
    var box=Components.FindComponent("CenterBox").Delegate as dynamic;

    //Curve tmp = polyline(x, true)[0];
    a=box(x,y,z,u);
    
  }
}
# ---------- end S ----------
S_2 = Script(x=<missing>)  # -> out, a; inputs x: Point3d
# ---------- S_2: C# ----------
// Grasshopper Script Instance
using System;
using System.Collections;
using System.Collections.Generic;
using System.Drawing;

using Rhino;
using Rhino.Geometry;

using Grasshopper;
using Grasshopper.Kernel;
using Grasshopper.Kernel.Data;
using Grasshopper.Kernel.Types;

using Rhino.NodeInCode;

public class Script_Instance : GH_ScriptInstance
{
  /* 
    Members:
      RhinoDoc RhinoDocument
      GH_Document GrasshopperDocument
      IGH_Component Component
      int Iteration

    Methods (Virtual & overridable):
      Print(string text)
      Print(string format, params object[] args)
      Reflect(object obj)
      Reflect(object obj, string method_name)
  */
  
  private void RunScript(Point3d x, out object a)
  {
    var box=Components.FindComponent("XYPlane").Delegate as dynamic;

    //Curve tmp = polyline(x, true)[0];
    a=box(x);
  }
}
# ---------- end S_2 ----------
item = ListItem(List=alongcrv.Points, Index=Slider(3, range=0..3), Wrap=True)
gs = GenSchool(
    PlotRatio=number_slider_4,
    BoundaryPoints=alongcrv.Points,
    PlaygroundS=crv_2,
    PlaygroundM=crv_3,
    PlaygroundL=crv_4,
    DayFactor=number_slider_4)  # -> OutputPG, OutputTeaching, OutputOther
geo = Geometry(gs.OutputPG)
geo_2 = Geometry(gs.OutputTeaching)
geo_3 = Geometry(gs.OutputOther)
Z = UnitZ(Factor=1)
extr = Extrude(Base=geo, Direction=Z)
merge = Merge(Data1=extr, Data2=geo_2, Data3=geo_3)
preview = CustomPreview(Geometry=merge, Material=ColourSwatch(SwatchColor=RGB(255, 255, 255)))
