# Grasshopper definition 中小学_生成式.gh (Grasshopper 1.0.7)

number_slider = Slider(3.63, range=0..6)
snum = Slider(1735, range=800..2000)
number_slider_2 = Slider(0, range=-45..45)
crv = Curve(<curve referenced from the Rhino model>)
area = Area(Geometry=crv)  # -> Area, Centroid
cp = ControlPoints(Curve=crv)  # -> Points, Weights, Knots
cir = Circle(Plane=area.Centroid, Radius=1)
cull_i = CullIndex(List=cp.Points, Indices=-1, Wrap=True)
crv_2 = Curve(reverse([<curve referenced from the Rhino model> x46]))
crv_3 = Curve(reverse([<curve referenced from the Rhino model> x32]))
crv_4 = Curve(reverse([<curve referenced from the Rhino model> x35]))
alongcrv = SortAlongCurve(Points=cull_i, Curve=cir)  # -> Points, Indices
python = GhPythonScript(
    SNum=snum,
    Boundary=alongcrv.Points,
    BDPG18=crv_2,
    BDPG24=crv_3,
    BDPG36=crv_4,
    dayFactor=number_slider,
    rotate=number_slider_2)  # -> out, SType, PG, PGfield, FSQ, BDs, BDSup, BDSP, BDOF; inputs SNum: Int32, Boundary: list of Point3d, BDPG18: list of Curve, BDPG24: list of Curve, BDPG36: list of Curve
# ---------- python: Python ----------
__author__ = "46314"
__version__ = "2021.11.03"

import random
import math
import rhinoscriptsyntax as rs
import Rhino.Geometry as rg
import ghpythonlib.components as gh
import clr
clr.AddReference("Grasshopper")
from Grasshopper.Kernel.Data import GH_Path
from Grasshopper import DataTree

#看学校是多少人多少班
def getSType(num):
    tmp=0
    if num<=45*24:
        tmp=0
    elif 45*24<num<=45*30:
        tmp=1
    elif 45*30<num<=45*36:
        tmp=2
    else:
        tmp=3
    return tmp

#根据比例得到直线上的点
def getCrvPt(pts,portion):
    vec=gh.VectorXYZ(portion*(pts[1].X-pts[0].X),portion*(pts[1].Y-pts[0].Y),0)[0]
    tmp=gh.ConstructPoint(pts[0].X+vec.X,pts[0].Y+vec.Y,0)
    return tmp
#把点的列表按顺时针顺序排序
def getBDPGPts(BDPG):
    nakedPts=gh.Discontinuity(BDPG,1)[0]
    cenPt=gh.Average(nakedPts)
    cenCircle=gh.Circle(cenPt,10)
    tmp=gh.SortAlongCurve(nakedPts,cenCircle)[0]
    return tmp

#得到每一组操场里的外框的长和宽
def getThreshold(PGGraph):
    tmp=[]
    for i in range(PGGraph.BranchCount):
        tt=[]
        tmpPts=getBDPGPts(PGGraph.Branch(i)[0])
        tt.append(gh.Length(gh.Line(tmpPts[0],tmpPts[1])))
        tt.append(gh.Length(gh.Line(tmpPts[2],tmpPts[1])))
        tmp.append(tt)
    return tmp

#教学区图形绘制相关
#根据教学区的边界地形长度得到能放多少组板楼
def getHowmanySetsofBuilding(dayFactor, siteLen):
    betweenLen=4*4*dayFactor
    if betweenLen>=25:
        betweenLen=betweenLen
    else:
        betweenLen=25
    n=int((siteLen)/(10+betweenLen))+1
    return n
#根据那根base的line和高度造体块
def getBoxes(lines,Hs,plane):
    tmp=[]
    area=0
    for i in range(len(lines)):
        Pts=gh.Discontinuity(lines[i],1)[0]
        widRec=gh.Length(lines[i])
        planeO=gh.Average(Pts)
        planeX=plane[i].XAxis
        planeY=plane[i].YAxis
        planeNew=gh.ConstructPlane(planeO,planeX,planeY)
        Pta=gh.ConstructPoint(planeO.X-widRec/2*planeX.X-5*planeY.X,planeO.Y-widRec/2*planeX.Y-5*planeY.Y,0)
        Ptb=gh.ConstructPoint(planeO.X+widRec/2*planeX.X+5*planeY.X,planeO.Y+widRec/2*planeX.Y+5*planeY.Y,4*Hs[i])
        tt=gh.Box2Pt(Pta,Ptb,planeNew)
        tmp.append(tt)
        area+=10*widRec*Hs[i]
    return [tmp,area]
#得到最后所有的教学楼
def getBDs(rotate, dayFactor, boundaryCrv):
    boundaryPts=getBDPGPts(boundaryCrv)
    r=getR(rotate)
    #根据朝向把新的退界边界定好
    between=abs(25*math.sin(r))
    leftright=abs(10*math.sin(r)*0.5)
    topbottom=abs(10*math.cos(r)*0.5)
    basePt=[]
    basePt.append(gh.ConstructPoint(boundaryPts[0].X-leftright,boundaryPts[0].Y-topbottom,0))
    basePt.append(gh.ConstructPoint(boundaryPts[1].X+leftright+between,boundaryPts[1].Y-topbottom,0))
    basePt.append(gh.ConstructPoint(boundaryPts[2].X+leftright+between,boundaryPts[2].Y+topbottom,0))
    basePt.append(gh.ConstructPoint(boundaryPts[3].X-leftright,boundaryPts[3].Y+topbottom,0))
    baseCrv=gh.PolyLine(basePt,True)
    #间隔是多少弄出来
    betweenLen=4*4*dayFactor
    if betweenLen>=25:
        betweenLen=betweenLen
    else:
        betweenLen=25
    #造转向之后的平面
    planeZ=gh.VectorXYZ(math.sin(-r),math.cos(-r),0)[0]
    planeX=gh.VectorXYZ(math.cos(-r),-math.sin(-r),0)[0]
    planeY=gh.VectorXYZ(0,0,1)[0]
    #得到边界siteLen
    minBDLen=40
    minLenH=abs(math.sin(r)*math.cos(r)*minBDLen)
    #分情况讨论
    if rotate<=0:
        #转向之后的两个边界点
        disPt0=gh.ConstructPoint(basePt[0].X-minLenH*math.sin(-r),basePt[0].Y-minLenH*math.cos(-r),0)
        disPt1=gh.ConstructPoint(basePt[2].X+minLenH*math.sin(-r),basePt[2].Y+minLenH*math.cos(-r),0)
        planeNew=gh.ConstructPlane(disPt1,planeX,planeY)
        siteLen=abs(gh.PlaneClosestPoint(disPt0,planeNew)[2])
        setNum=getHowmanySetsofBuilding(dayFactor, siteLen)
        #由边界点所构造平面得交点
        baseLines=[]
        baseH=[]
        basePlanes=[]
        for i in range(setNum):
            planePt=gh.ConstructPoint(disPt0.X-i*(betweenLen+10)*math.sin(-r),disPt0.Y-i*(betweenLen+10)*math.cos(-r),0)
            planeInter=gh.ConstructPlane(planePt,planeX,planeY)
            planeRec=gh.ConstructPlane(planePt,planeX,planeZ)
            tmpPt=rs.PlaneCurveIntersection(planeInter,baseCrv)
            tmpPt[0]=gh.ConstructPoint(tmpPt[0][1][0],tmpPt[0][1][1],0)
            tmpPt[1]=gh.ConstructPoint(tmpPt[1][1][0],tmpPt[1][1][1],0)
            tmpLine=gh.PolyLine(tmpPt,False)
            baseLines.append(tmpLine)
            baseH.append(4)
            basePlanes.append(planeRec)
        lenReamin=siteLen-(10+betweenLen)*(setNum-1)
        if lenReamin<35:
            baseLines=baseLines
        else:
            newH=int((lenReamin-10)/(dayFactor*4))
            planeInter=gh.ConstructPlane(disPt1,planeX,planeY)
            planeRec=gh.ConstructPlane(disPt1,planeX,planeZ)
            tmpPt=rs.PlaneCurveIntersection(planeInter,baseCrv)
            tmpPt[0]=gh.ConstructPoint(tmpPt[0][1][0],tmpPt[0][1][1],0)
            tmpPt[1]=gh.ConstructPoint(tmpPt[1][1][0],tmpPt[1][1][1],0)
            tmpLine=gh.PolyLine(tmpPt,False)
            baseLines.append(tmpLine)
            baseH.append(newH)
            basePlanes.append(planeRec)
        [BDs,area]=getBoxes(baseLines,baseH,basePlanes)
    else:
        disPt0=gh.ConstructPoint(basePt[1].X+minLenH*math.sin(r),basePt[1].Y-minLenH*math.cos(r),0)
        disPt1=gh.ConstructPoint(basePt[3].X-minLenH*math.sin(r),basePt[3].Y+minLenH*math.cos(r),0)
        planeNew=gh.ConstructPlane(disPt1,planeX,planeY)
        siteLen=abs(gh.PlaneClosestPoint(disPt0,planeNew)[2])
        setNum=getHowmanySetsofBuilding(dayFactor, siteLen)
        #由边界点所构造平面得交点
        baseLines=[]
        baseH=[]
        basePlanes=[]
        for i in range(setNum):
            planePt=gh.ConstructPoint(disPt0.X-i*(betweenLen+10)*math.sin(-r),disPt0.Y-i*(betweenLen+10)*math.cos(-r),0)
            planeInter=gh.ConstructPlane(planePt,planeX,planeY)
            planeRec=gh.ConstructPlane(planePt,planeX,planeZ)
            tmpPt=rs.PlaneCurveIntersection(planeInter,baseCrv)
            tmpPt[0]=gh.ConstructPoint(tmpPt[0][1][0],tmpPt[0][1][1],0)
            tmpPt[1]=gh.ConstructPoint(tmpPt[1][1][0],tmpPt[1][1][1],0)
            tmpLine=gh.PolyLine(tmpPt,False)
            baseLines.append(tmpLine)
            baseH.append(4)
            basePlanes.append(planeRec)
        lenReamin=siteLen-(10+betweenLen)*(setNum-1)
        if lenReamin<35:
            baseLines=baseLines
        else:
            newH=int((lenReamin-10)/(dayFactor*4))
            planeInter=gh.ConstructPlane(disPt1,planeX,planeY)
            planeRec=gh.ConstructPlane(disPt1,planeX,planeZ)
            tmpPt=rs.PlaneCurveIntersection(planeInter,baseCrv)
            tmpPt[0]=gh.ConstructPoint(tmpPt[0][1][0],tmpPt[0][1][1],0)
            tmpPt[1]=gh.ConstructPoint(tmpPt[1][1][0],tmpPt[1][1][1],0)
            tmpLine=gh.PolyLine(tmpPt,False)
            baseLines.append(tmpLine)
            baseH.append(newH)
            basePlanes.append(planeRec)
        [BDs,area]=getBoxes(baseLines,baseH,basePlanes)
    return [BDs,area]

#根据阳光转一转的一系列
#角度到弧度
def getR(n):
    return math.pi/180*n
#旋转后并把点顺时针排列
def getRotatedPts(base, rotate):
    nakedPts=gh.Discontinuity(base,1)[0]
    cenPt=gh.Average(nakedPts)
    base=gh.Rotate(base,getR(rotate),gh.XYPlane(cenPt))[0]
    cenCircle=gh.Circle(cenPt,10)
    nakedPts=gh.SortAlongCurve(nakedPts,cenCircle)[0]
    nakedPts=gh.Rotate(nakedPts,getR(rotate),gh.XYPlane(cenPt))[0]
    return [nakedPts,cenPt]
#旋转后的边界矩形
def getSimpleBoundary(base, rotate):
    basePts=getRotatedPts(base, rotate)[0]
    if rotate>=0:
        pt0=gh.ConstructPoint(basePts[1].X,basePts[0].Y,0)
        pt1=gh.ConstructPoint(basePts[3].X,basePts[2].Y,0)
    else:
        pt0=gh.ConstructPoint(basePts[0].X,basePts[1].Y,0)
        pt1=gh.ConstructPoint(basePts[2].X,basePts[3].Y,0)
    tmp=gh.Rectangle2Pt(rs.WorldXYPlane(),pt0,pt1,0)[0]
    return tmp
#根据所输入三角形最大化放入篮球场地
def getBasketballField(pts):
    L01=gh.Distance(pts[0],pts[1])
    L12=gh.Distance(pts[2],pts[1])
    L20=gh.Distance(pts[0],pts[2])
    newPlane=gh.Plane3Pt(pts[2],pts[0],pts[1])
    vecX=gh.DeconstructPlane(newPlane)[1]
    vecY=gh.DeconstructPlane(newPlane)[2]
    triH=L01*L12/L20
    remainH=(1-32/L20)*triH
    row=int(remainH/19)
    tmp=[]
    if row>0:
        for i in range(row):
            remainL20=(triH-19*(i+1))/triH*L20
            col=int((remainL20)/32)
            for j in range(col):
                vecLenX=19*L12/L01*(i+1)+j*32
                moveX=vecX*vecLenX
                moveY=vecY*19*i
                recPt=gh.ConstructPoint(pts[2].X+moveX.X+moveY.X,pts[2].Y+moveX.Y+moveY.Y,0)
                recPlane=gh.ConstructPlane(recPt,vecX,vecY)
                tmp.append(gh.Rectangle(recPlane,32,19,0)[0])
    return tmp
#室内体育场，根据三角形看放入了多少个篮球场地
def getBasketballFieldInterTop(fieldNum,basePts,rotate):
    r=getR(rotate)
    a=gh.Distance(basePts[0],basePts[1])
    b=gh.Distance(basePts[2],basePts[1])
    col=int((a-32*math.tan(r))/19)
    recs=[]
    for i in range(col):
        row=int((32*math.tan(r)+i*19)/math.tan(r)/32)
        for j in range(row):
            recPt=gh.ConstructPoint(basePts[0].X+32*math.tan(r)+i*19,basePts[0].Y-j*32,0)
            tt=gh.Rectangle(recPt,19,-32,0)[0]
            recs.append(tt)
    if len(recs)>=fieldNum:
        widMore=0
    else:
        rowLast=int((32*math.tan(r)+(col-1)*19)/math.tan(r)/32)
        widNum=int((fieldNum-len(recs))/rowLast-0.5)+1
        widMore=19*widNum-(a-col*19-32*math.tan(r))
        for i in range(widNum):
            for j in range(rowLast):
                recPt=gh.ConstructPoint(basePts[0].X+32*math.tan(r)+col*19+i*19,basePts[0].Y-j*32,0)
                tt=gh.Rectangle(recPt,19,-32,0)[0]
                recs.append(tt)
    return [widMore,recs]
#室内体育场另一种情况
def getBasketballFieldInterBottom(fieldNum,basePts,rotate):
    r=getR(rotate)
    a=gh.Distance(basePts[0],basePts[1])
    b=gh.Distance(basePts[2],basePts[1])
    col=int((a-32*math.tan(r))/19)
    recs=[]
    for i in range(col):
        row=int((32*math.tan(r)+i*19)/math.tan(r)/32)
        for j in range(row):
            recPt=gh.ConstructPoint(basePts[0].X+32*math.tan(r)+i*19,basePts[0].Y+j*32,0)
            tt=gh.Rectangle(recPt,19,32,0)[0]
            recs.append(tt)
    if len(recs)>=fieldNum:
        widMore=0
    else:
        rowLast=int((32*math.tan(r)+(col-1)*19)/math.tan(r)/32)
        widNum=int((fieldNum-len(recs))/rowLast-0.5)+1
        widMore=19*widNum-(a-col*19-32*math.tan(r))
        for i in range(widNum):
            for j in range(rowLast):
                recPt=gh.ConstructPoint(basePts[0].X+32*math.tan(r)+col*19+i*19,basePts[0].Y+j*32,0)
                tt=gh.Rectangle(recPt,19,32,0)[0]
                recs.append(tt)
    return [widMore,recs]
#另一个情况的教师办公
def getOF(basePt,rotate,denOF,SNum):
    box=0
    r=getR(rotate)
    a=gh.Distance(basePt[0],basePt[1])
    b=gh.Distance(basePt[2],basePt[1])
    areaOF=denOF*SNum
    areaBase=areaOF/6
    widOFNeed=areaBase/6
    widOFNow=a-6*math.tan(-r)
    ori=gh.ConstructPoint(0,0,0)
    if widOFNow>=widOFNeed:
        widOFMore=0
        pt0=gh.ConstructPoint(basePt[0].X+6*math.tan(-r),basePt[0].Y,0)
        pt1=gh.ConstructPoint(basePt[1].X,basePt[1].Y+6,6*4)
        box=gh.Box2Pt(pt0,pt1,gh.XYPlane(ori))
    else:
        widOFMore=widOFNeed-widOFNow
        pt0=gh.ConstructPoint(basePt[0].X+6*math.tan(-r),basePt[0].Y,0)
        pt1=gh.ConstructPoint(basePt[1].X+widOFMore,basePt[1].Y+6,6*4)
        box=gh.Box2Pt(pt0,pt1,gh.XYPlane(ori))
    return [widOFMore,box]

#算食堂/体育馆所需宽度
def getWidSup(rotate,basePts,SNum,denSup,fieldNum):
    r=getR(rotate)
    a=gh.Distance(basePts[0],basePts[1])
    b=gh.Distance(basePts[2],basePts[1])
    areaSup=SNum*denSup
    widSupNeed=(4/3*areaSup)**0.5
    lenSupNeed=3/4*widSupNeed
    if rotate>=0:
        widSupNow=b-lenSupNeed/math.tan(r)
        if widSupNow>=widSupNeed:
            widMoreSup=0
        else:
            widMoreSup=widSupNeed-widSupNow
        portionSP=1-lenSupNeed/a
        SPpts=[]
        SPpts.append(getCrvPt([basePts[0],basePts[2]],portionSP))
        SPpts.append(getCrvPt([basePts[0],basePts[1]],portionSP))
        SPpts.append(basePts[0])
        [widMoreSP,fieldSP]=getBasketballFieldInterTop(fieldNum,SPpts,rotate)
        widMore=gh.Maximum(widMoreSup,widMoreSP)
        return [widMore,fieldSP,portionSP]
    else:
        if lenSupNeed<=a:
            widMoreNow=b-(lenSupNeed/(math.tan(-r)))
            if widMoreNow>=widSupNeed:
                widMoreSup=0
            else:
                widMoreSup=widSupNeed-widMoreNow
            return widMoreSup
        else:
            print '该场地无法放置符合要求的食堂'
#算办公/体育馆所需宽度
def getWidOF(rotate,basePts,SNum,denOF,fieldNum):
    r=getR(rotate)
    if rotate>=0:
        a=gh.Distance(basePts[0],basePts[1])
        b=gh.Distance(basePts[2],basePts[1])
        areaOF=SNum*denOF
        if b>=6:
            widOF=a-6/math.tan(r)
            lenOF=b-6*math.tan(r)
            if lenOF>=6:
                if (widOF*6+(lenOF-6)*6)*6>=areaOF:
                    widMoreOF=0
                    H=int(areaOF/(widOF*6+(lenOF-6)*6))+1
                    boxOF=[]
                    boxOF.append(gh.Box2Pt(gh.ConstructPoint(basePts[1].X-widOF,basePts[1].Y,0),gh.ConstructPoint(basePts[1].X,basePts[1].Y+6,H*4),rs.WorldXYPlane()))
                    boxOF.append(gh.Box2Pt(gh.ConstructPoint(basePts[1].X,basePts[1].Y+lenOF,0),gh.ConstructPoint(basePts[1].X-6,basePts[1].Y+6,H*4),rs.WorldXYPlane()))
                else:
                    widMoreOF=(areaOF-(widOF*6+(lenOF-6)*6)*6)/6/lenOF
                    H=6
                    boxOF=[]
                    boxOF.append(gh.Box2Pt(gh.ConstructPoint(basePts[1].X-widOF,basePts[1].Y,0),gh.ConstructPoint(basePts[1].X-6,basePts[1].Y+6,H*4),rs.WorldXYPlane()))
                    boxOF.append(gh.Box2Pt(gh.ConstructPoint(basePts[1].X+widMoreOF,basePts[1].Y+lenOF,0),gh.ConstructPoint(basePts[1].X-6,basePts[1].Y,H*4),rs.WorldXYPlane()))
                return [widMoreOF,boxOF]
            else:
                if widOF*6*6>=areaOF:
                    widMoreOF=0
                    H=int(areaOF/(widOF*6))+1
                    boxOF=gh.Box2Pt(gh.ConstructPoint(basePts[1].X-widOF,basePts[1].Y,0),gh.ConstructPoint(basePts[1].X,basePts[1].Y+6,H*4),rs.WorldXYPlane())
                else:
                    widMoreOF=(areaOF-widOF*6*6)/6/6
                    H=6
                    boxOF=gh.Box2Pt(gh.ConstructPoint(basePts[1].X-widOF,basePts[1].Y,0),gh.ConstructPoint(basePts[1].X+widMoreOF,basePts[1].Y+6,H*4),rs.WorldXYPlane())
                return [widMoreOF,boxOF]
        else:
            print '该场地无法放置符合要求的教师办公'
    else:
        a=gh.Distance(basePts[0],basePts[1])
        b=gh.Distance(basePts[2],basePts[1])
        [widMoreOF,BDOF]=getOF(basePts,rotate,denOF,SNum)
        portionSP=1-6/b
        SPpts=[]
        SPpts.append(getCrvPt([basePts[2],basePts[1]],portionSP))
        SPpts.append(getCrvPt([basePts[2],basePts[0]],portionSP))
        SPpts.append(basePts[2])
        [widMoreSP,fieldSP]=getBasketballFieldInterBottom(fieldNum,SPpts,rotate)
        widMore=gh.Maximum(widMoreOF,widMoreSP)
        return [widMore,fieldSP,BDOF]

#旋转角度大于0的情况 得出所需增加宽度
def getWidMoreMore(denSup,SNum,triPtSupSP,fieldNum,denSP,denOF,triPtOF):
    a=gh.Distance(triPtSupSP[0],triPtSupSP[1])
    b=gh.Distance(triPtSupSP[2],triPtSupSP[1])
    aOF=gh.Distance(triPtOF[0],triPtOF[1])
    bOF=gh.Distance(triPtOF[2],triPtOF[1])
    areaSup=denSup*SNum
    areaOF=denOF*SNum
    if fieldNum<=0:
        areaSP=denSP
    else:
        areaSP=fieldNum*denSP
    #体育馆比例
    protionSP=(areaSP/(areaSP+areaSup))**0.5
    areaSPNow=a*b*protionSP**2/2
    areaSupNow=a*b/2-areaSPNow
    areaOFNow=aOF*bOF/2
    areaSPNeed=areaSP-areaSPNow
    areaSupNeed=areaSup-areaSupNow
    areaOFNeed=areaOF-areaOFNow
    if areaSPNeed>0:
        widSP=areaSPNeed/(a*protionSP)
    else :
        widSP=0
    if areaSupNeed>0:
        widSup=areaSupNeed/(a*(1-protionSP))
    else :
        widSup=0
    if areaOFNeed>0:
        widOF=areaOFNeed/bOF
    else :
        widOF=0
    widMore=gh.Maximum(gh.Maximum(widSP,widSup),widOF)
    return [protionSP,widMore]
#旋转角度小于0的情况  得出所需增加宽度
def getWidMoreLess(denSup,SNum,triPtOFSP,fieldNum,denSP,denOF,triPtSup):
    a=gh.Distance(triPtOFSP[2],triPtOFSP[1])
    b=gh.Distance(triPtOFSP[0],triPtOFSP[1])
    aSup=gh.Distance(triPtSup[0],triPtSup[1])
    bSup=gh.Distance(triPtSup[2],triPtSup[1])
    areaSup=denSup*SNum
    areaOF=denOF*SNum
    if fieldNum<=0:
        areaSP=denSP
    else:
        areaSP=fieldNum*denSP
    #体育馆比例
    protionSP=(areaSP/(areaSP+areaOF))**0.5
    areaSPNow=a*b*protionSP**2/2
    areaOFNow=a*b/2-areaSPNow
    areaSupNow=aSup*bSup/2
    areaSPNeed=areaSP-areaSPNow
    areaSupNeed=areaSup-areaSupNow
    areaOFNeed=areaOF-areaOFNow
    if areaSPNeed>0:
        widSP=areaSPNeed/(a*protionSP)
    else :
        widSP=0
    if areaOFNeed>0:
        widOF=areaOFNeed/(a*(1-protionSP))
    else :
        widOF=0
    if areaSupNeed>0:
        widSup=areaSupNeed/bSup
    else :
        widSup=0
    widMore=gh.Maximum(gh.Maximum(widSP,widSup),widOF)
    return [protionSP,widMore]

#得到旋转后的操场/篮球场/体育馆/食堂/教师办公
def getPGRelated(base, rotate, SNum, denSup, denSP, feildNeed, denOF):
    boundaryCrv=getSimpleBoundary(base[0], rotate)
    boundaryPts=getBDPGPts(boundaryCrv)
    [basePts,cenPt]=getRotatedPts(base[0], rotate)
    field=[]
    PG=[]
    #得出旋转之后的操场
    for i in base:
        PG.append(gh.Rotate(i,getR(rotate),gh.XYPlane(cenPt))[0])
    #得出其他
    if rotate>=0:
        tri0=[basePts[3],boundaryPts[0],basePts[0]]
        tri1=[basePts[0],boundaryPts[1],basePts[1]]
        tri2=[basePts[1],boundaryPts[2],basePts[2]]
        tri3=[basePts[2],boundaryPts[3],basePts[3]]
        #得出最靠左边的篮球场
        field.append(getBasketballField(tri1))
        field.append(getBasketballField(tri2))
        fieldMore=0
        for i in field:
            fieldMore+=len(i)
        #算所需的扩展空间
        #所需额外篮球场个数
        fieldNum=feildNeed-fieldMore
        if fieldNum<=0:
            fieldNum=0
        else:
             fieldNum=fieldNum
        #这种情况的办公
        [widMoreOF,BDOF]=getWidOF(rotate,tri3,SNum,denOF,fieldNum)
        #这种情况的食堂和体育馆
        [widMoreSupSP,BDSP,portionSP]=getWidSup(rotate,tri0,SNum,denSup,fieldNum)
        widMore=gh.Maximum(widMoreOF,widMoreSupSP)
        if widMore==0:
            #得出食堂
            BDSup=gh.PolyLine([midPt0,tri0[1],tri0[2],midPt1],True)
            BDSup=gh.OffsetCurve(BDSup,-2,rs.WorldXYPlane(),1)
        else:
            tmpL0=gh.Line(tri0[0],tri0[1])
            tmpL1=gh.Line(tri0[0],tri0[2])
            midPt0=getCrvPt(tmpL0,portionSP)
            midPt1=getCrvPt(tmpL1,portionSP)
            morePt0=gh.ConstructPoint(tri0[0].X+widMore,tri0[0].Y,0)
            morePt1=gh.ConstructPoint(tri0[1].X+widMore,tri0[1].Y,0)
            midPt2=gh.ConstructPoint(midPt0.X+widMore,midPt0.Y,0)
            #得出食堂
            BDSup=gh.PolyLine([midPt2,morePt1,tri0[2],midPt1],True)
            BDSup=gh.OffsetCurve(BDSup,-2,rs.WorldXYPlane(),1)
    else:
        tri0=[basePts[0],boundaryPts[0],basePts[1]]
        tri1=[basePts[1],boundaryPts[1],basePts[2]]
        tri2=[basePts[2],boundaryPts[2],basePts[3]]
        tri3=[basePts[3],boundaryPts[3],basePts[0]]
        field.append(getBasketballField(tri1))
        field.append(getBasketballField(tri2))
        fieldMore=0
        for i in field:
            fieldMore+=len(i)
        #算所需的扩展空间
        #所需额外篮球场个数
        fieldNum=feildNeed-fieldMore
        if fieldNum<=0:
            fieldNum=0
        else:
             fieldNum=fieldNum
        #这种情况的食堂
        widMoreSup=getWidSup(rotate,tri0,SNum,denSup,fieldNum)
        #这种情况的办公和体育馆
        [widMoreSPOF,BDSP,BDOF]=getWidOF(rotate,tri3,SNum,denOF,fieldNum)
        widMore=gh.Maximum(widMoreSup,widMoreSPOF)
        if widMore==0:
            #得出食堂
            BDSup=gh.PolyLine(tri0,True)
            BDSup=gh.OffsetCurve(BDSup,-2,rs.WorldXYPlane(),1)
        else:
            #得出食堂
            SupPt0=gh.ConstructPoint(tri0[0].X+widMore,tri0[0].Y,0)
            SupPt1=gh.ConstructPoint(tri0[1].X+widMore,tri0[1].Y,0)
            BDSup=gh.PolyLine([SupPt0,SupPt1,tri0[2],tri0[0]],True)
            BDSup=gh.OffsetCurve(BDSup,-2,rs.WorldXYPlane(),1)
    threshold=[]
    threshold.append(gh.Distance(boundaryPts[0],boundaryPts[1])+widMore)
    threshold.append(gh.Distance(boundaryPts[2],boundaryPts[1]))
    return [PG, field, BDSup,BDSP,BDOF,threshold,boundaryPts]

#得到所有的地块图形
def getPGType(BDAllPt, PGGraph, dayFactor, denBD, denSup, denSP, denOF, feildNeed, rotate, SNum):
    #先看操场及其相关能不能放得下
    widBDAll=gh.Length(gh.Line(BDAllPt[0],BDAllPt[1]))
    lenBDAll=gh.Length(gh.Line(BDAllPt[2],BDAllPt[1]))
    [PG, PGfield, BDSup,BDSP,BDOF,thresholdValue,boundaryPts]=getPGRelated(PGGraph, rotate, SNum, denSup, denSP, feildNeed,denOF)
    bigBetween=5
    
    if widBDAll>=thresholdValue[0] and lenBDAll>=thresholdValue[1]:
        moveX=thresholdValue[0]
        moveY=thresholdValue[1]
    else:
        print '该场地无法放置满足条件的操场'
        return 0
    #两种情况看剩余功能怎么分布
    #第一种操场加疏散的情况
    if moveX*(lenBDAll-moveY-2-2-2)>=500:
        #得出操场 食堂 篮球场 体育场 办公
        vecMove=gh.VectorXYZ(BDAllPt[1].X+2-boundaryPts[1].X,BDAllPt[1].Y-2-boundaryPts[1].Y,0)[0]
        PG=gh.Move(PG,vecMove)[0]
        BDSup=gh.Move(BDSup,vecMove)[0]
        BDSP=gh.Move(BDSP,vecMove)[0]
        BDOF=gh.Move(BDOF,vecMove)[0]
        for i in range(len(PGfield)):
            PGfield[i]=gh.Move(PGfield[i],vecMove)[0]
        #得出疏散广场
        lenSQ=lenBDAll-moveY-2-2-2
        widSQ=moveX
        recPtSQ=gh.ConstructPoint(BDAllPt[2].X+2,BDAllPt[2].Y+2,0)
        FSQ=gh.Rectangle(recPtSQ,widSQ,lenSQ,0)[0]
        #再算教学楼区域
        BDPt=gh.ConstructPoint(BDAllPt[1].X+2+moveX+bigBetween,BDAllPt[2].Y+2,0)
        BDoutline=gh.Rectangle(BDPt,widBDAll-2-moveX-bigBetween-2,lenBDAll-2-2,0)[0]
        [BDs,areaBDNow]=getBDs(rotate,dayFactor,BDoutline)
        areaBDRe=denBD*SNum
        if areaBDNow>=areaBDRe:
            BDs=BDs
        else :
            print '该场地无法放置满足条件的教学楼'
            return 0
            
    #第二种操场加疏散的情况
    else:
        #得出操场 食堂 篮球场 体育场 教师办公
        vecMove=gh.VectorXYZ(BDAllPt[1].X+2-boundaryPts[1].X,BDAllPt[1].Y-2-boundaryPts[1].Y,0)[0]
        PG=gh.Move(PG,vecMove)[0]
        BDSup=gh.Move(BDSup,vecMove)[0]
        BDSP=gh.Move(BDSP,vecMove)[0]
        BDOF=gh.Move(BDOF,vecMove)[0]
        for i in range(len(PGfield)):
            PGfield[i]=gh.Move(PGfield[i],vecMove)[0]
        #得出疏散广场
        widSQ=widBDAll-moveX-2-bigBetween-2
        lenSQ=(500.0)/(widSQ)
        recPtSQ=gh.ConstructPoint(BDAllPt[2].X+2+moveX+bigBetween,BDAllPt[2].Y+2,0)
        FSQ=gh.Rectangle(recPtSQ,widSQ,lenSQ,0)[0]
        #再算教学区域
        BDPt=gh.ConstructPoint(BDAllPt[1].X+2+moveX+bigBetween,BDAllPt[2].Y+2+lenSQ+2,0)
        BDoutline=gh.Rectangle(BDPt,widBDAll-2-moveX-bigBetween-2,lenBDAll-2-2-2-lenSQ,0)[0]
        [BDs,areaBDNow]=getBDs(rotate,dayFactor,BDoutline)
        areaBDRe=denBD*SNum
        if areaBDNow>=areaBDRe:
            BDs=BDs
        else :
            print '该场地无法放置满足条件的教学楼'
            return 0
        
    
    return [PG,PGfield,BDSup,BDSP,FSQ,BDOF,BDs]

SType=getSType(SNum)

if abs(rotate)>10:
    if SType==0:
        [PG,PGfield,BDSup,BDSP,FSQ,BDOF,BDs]=getPGType(Boundary,BDPG18,dayFactor,7.5,1.2,1000,0.79,0,rotate,SNum)
    elif SType==1:
        [PG,PGfield,BDSup,BDSP,FSQ,BDOF,BDs]=getPGType(Boundary,BDPG24,dayFactor,7.3,1.2,1000,0.74,4,rotate,SNum)
    elif SType==2:
        [PG,PGfield,BDSup,BDSP,FSQ,BDOF,BDs]=getPGType(Boundary,BDPG24,dayFactor,7.0,1.2,1000,0.69,4,rotate,SNum)
    else:
        [PG,PGfield,BDSup,BDSP,FSQ,BDOF,BDs]=getPGType(Boundary,BDPG36,dayFactor,6.7,1.2,1000,0.66,6,rotate,SNum)
# ---------- end python ----------
panel = Panel(python.out)
python_2 = GhPythonScript(x=python.PGfield)  # -> out, a
# ---------- python_2: Python ----------
__author__ = "46314"
__version__ = "2021.11.03"

import random
import math
import rhinoscriptsyntax as rs
import Rhino.Geometry as rg
import ghpythonlib.components as gh
import clr
clr.AddReference("Grasshopper")
from Grasshopper.Kernel.Data import GH_Path
from Grasshopper import DataTree

a=x
# ---------- end python_2 ----------
crv_5 = Curve(reverse([<curve referenced from the Rhino model> x46]))
crv_6 = Curve(reverse([<curve referenced from the Rhino model> x43]))
crv_7 = Curve(reverse([<curve referenced from the Rhino model> x42]))
crv_8 = Curve(reverse([<curve referenced from the Rhino model> x50]))
crv_9 = Curve(reverse([<curve referenced from the Rhino model> x60]))
entwine = Entwine(Branch00=crv_5, Branch01=crv_5, FlattenInputs=True)
entwine_2 = Entwine(Branch00=crv_6, Branch01=crv_7, FlattenInputs=True)
entwine_3 = Entwine(Branch00=crv_8, Branch01=crv_9, FlattenInputs=True)

crv_10 = Curve(python.PG)
crv_11 = Curve(python_2.a)
crv_12 = Curve(python.FSQ)
geo = Geometry(python.BDs)
crv_13 = Curve(python.BDSup)
crv_14 = Curve(python.BDSP)
geo_2 = Geometry(python.BDOF)

python_3 = GhPythonScript(
    SNum=snum,
    Boundary=alongcrv.Points,
    BDPG18=crv_2,
    BDPG24=crv_3,
    BDPG36=crv_4,
    dayFactor=number_slider,
    rotate=number_slider_2)  # -> out, SType, PG, PGfield, FSQ, BDs, BDSup, BDSP, BDOF; inputs SNum: Int32, Boundary: list of Point3d, BDPG18: list of Curve, BDPG24: list of Curve, BDPG36: list of Curve
# ---------- python_3: Python ----------
__author__ = "46314"
__version__ = "2021.11.03"

import random
import math
import rhinoscriptsyntax as rs
import Rhino.Geometry as rg
import ghpythonlib.components as gh
import clr
clr.AddReference("Grasshopper")
from Grasshopper.Kernel.Data import GH_Path
from Grasshopper import DataTree

#看学校是多少人多少班
def getSType(num):
    tmp=0
    if num<=45*24:
        tmp=0
    elif 45*24<num<=45*30:
        tmp=1
    elif 45*30<num<=45*36:
        tmp=2
    else:
        tmp=3
    return tmp

#把点的列表按顺时针顺序排序
def getBDPGPts(BDPG):
    nakedPts=gh.Discontinuity(BDPG,1)[0]
    cenPt=gh.Average(nakedPts)
    cenCircle=gh.Circle(cenPt,10)
    tmp=gh.SortAlongCurve(nakedPts,cenCircle)[0]
    return tmp

#得到每一组操场里的外框的长和宽
def getThreshold(PGGraph):
    tmp=[]
    for i in range(PGGraph.BranchCount):
        tt=[]
        tmpPts=getBDPGPts(PGGraph.Branch(i)[0])
        tt.append(gh.Length(gh.Line(tmpPts[0],tmpPts[1])))
        tt.append(gh.Length(gh.Line(tmpPts[2],tmpPts[1])))
        tmp.append(tt)
    return tmp

#教学区图形绘制相关
#根据教学区的边界地形长度得到能放多少组板楼
def getHowmanySetsofBuilding(dayFactor, siteLen):
    betweenLen=4*4*dayFactor
    if betweenLen>=25:
        betweenLen=betweenLen
    else:
        betweenLen=25
    n=int((siteLen)/(10+betweenLen))+1
    return n
#根据那根base的line和高度造体块
def getBoxes(lines,Hs,plane):
    tmp=[]
    area=0
    for i in range(len(lines)):
        Pts=gh.Discontinuity(lines[i],1)[0]
        widRec=gh.Length(lines[i])
        planeO=gh.Average(Pts)
        planeX=plane[i].XAxis
        planeY=plane[i].YAxis
        planeNew=gh.ConstructPlane(planeO,planeX,planeY)
        Pta=gh.ConstructPoint(planeO.X-widRec/2*planeX.X-5*planeY.X,planeO.Y-widRec/2*planeX.Y-5*planeY.Y,0)
        Ptb=gh.ConstructPoint(planeO.X+widRec/2*planeX.X+5*planeY.X,planeO.Y+widRec/2*planeX.Y+5*planeY.Y,4*Hs[i])
        tt=gh.Box2Pt(Pta,Ptb,planeNew)
        tmp.append(tt)
        area+=10*widRec*Hs[i]
    return [tmp,area]
#得到最后所有的教学楼
def getBDs(rotate, dayFactor, boundaryCrv):
    boundaryPts=getBDPGPts(boundaryCrv)
    r=getR(rotate)
    #根据朝向把新的退界边界定好
    between=abs(25*math.sin(r))
    leftright=abs(10*math.sin(r)*0.5)
    topbottom=abs(10*math.cos(r)*0.5)
    basePt=[]
    basePt.append(gh.ConstructPoint(boundaryPts[0].X-leftright,boundaryPts[0].Y-topbottom,0))
    basePt.append(gh.ConstructPoint(boundaryPts[1].X+leftright+between,boundaryPts[1].Y-topbottom,0))
    basePt.append(gh.ConstructPoint(boundaryPts[2].X+leftright+between,boundaryPts[2].Y+topbottom,0))
    basePt.append(gh.ConstructPoint(boundaryPts[3].X-leftright,boundaryPts[3].Y+topbottom,0))
    baseCrv=gh.PolyLine(basePt,True)
    #间隔是多少弄出来
    betweenLen=4*4*dayFactor
    if betweenLen>=25:
        betweenLen=betweenLen
    else:
        betweenLen=25
    #造转向之后的平面
    planeZ=gh.VectorXYZ(math.sin(-r),math.cos(-r),0)[0]
    planeX=gh.VectorXYZ(math.cos(-r),-math.sin(-r),0)[0]
    planeY=gh.VectorXYZ(0,0,1)[0]
    #得到边界siteLen
    minBDLen=40
    minLenH=abs(math.sin(r)*math.cos(r)*minBDLen)
    #分情况讨论
    if rotate<=0:
        #转向之后的两个边界点
        disPt0=gh.ConstructPoint(basePt[0].X-minLenH*math.sin(-r),basePt[0].Y-minLenH*math.cos(-r),0)
        disPt1=gh.ConstructPoint(basePt[2].X+minLenH*math.sin(-r),basePt[2].Y+minLenH*math.cos(-r),0)
        planeNew=gh.ConstructPlane(disPt1,planeX,planeY)
        siteLen=abs(gh.PlaneClosestPoint(disPt0,planeNew)[2])
        setNum=getHowmanySetsofBuilding(dayFactor, siteLen)
        #由边界点所构造平面得交点
        baseLines=[]
        baseH=[]
        basePlanes=[]
        for i in range(setNum):
            planePt=gh.ConstructPoint(disPt0.X-i*(betweenLen+10)*math.sin(-r),disPt0.Y-i*(betweenLen+10)*math.cos(-r),0)
            planeInter=gh.ConstructPlane(planePt,planeX,planeY)
            planeRec=gh.ConstructPlane(planePt,planeX,planeZ)
            tmpPt=rs.PlaneCurveIntersection(planeInter,baseCrv)
            tmpPt[0]=gh.ConstructPoint(tmpPt[0][1][0],tmpPt[0][1][1],0)
            tmpPt[1]=gh.ConstructPoint(tmpPt[1][1][0],tmpPt[1][1][1],0)
            tmpLine=gh.PolyLine(tmpPt,False)
            baseLines.append(tmpLine)
            baseH.append(4)
            basePlanes.append(planeRec)
        lenReamin=siteLen-(10+betweenLen)*(setNum-1)
        if lenReamin<35:
            baseLines=baseLines
        else:
            newH=int((lenReamin-10)/(dayFactor*4))
            planeInter=gh.ConstructPlane(disPt1,planeX,planeY)
            planeRec=gh.ConstructPlane(disPt1,planeX,planeZ)
            tmpPt=rs.PlaneCurveIntersection(planeInter,baseCrv)
            tmpPt[0]=gh.ConstructPoint(tmpPt[0][1][0],tmpPt[0][1][1],0)
            tmpPt[1]=gh.ConstructPoint(tmpPt[1][1][0],tmpPt[1][1][1],0)
            tmpLine=gh.PolyLine(tmpPt,False)
            baseLines.append(tmpLine)
            baseH.append(newH)
            basePlanes.append(planeRec)
        [BDs,area]=getBoxes(baseLines,baseH,basePlanes)
    else:
        disPt0=gh.ConstructPoint(basePt[1].X+minLenH*math.sin(r),basePt[1].Y-minLenH*math.cos(r),0)
        disPt1=gh.ConstructPoint(basePt[3].X-minLenH*math.sin(r),basePt[3].Y+minLenH*math.cos(r),0)
        planeNew=gh.ConstructPlane(disPt1,planeX,planeY)
        siteLen=abs(gh.PlaneClosestPoint(disPt0,planeNew)[2])
        setNum=getHowmanySetsofBuilding(dayFactor, siteLen)
        #由边界点所构造平面得交点
        baseLines=[]
        baseH=[]
        basePlanes=[]
        for i in range(setNum):
            planePt=gh.ConstructPoint(disPt0.X-i*(betweenLen+10)*math.sin(-r),disPt0.Y-i*(betweenLen+10)*math.cos(-r),0)
            planeInter=gh.ConstructPlane(planePt,planeX,planeY)
            planeRec=gh.ConstructPlane(planePt,planeX,planeZ)
            tmpPt=rs.PlaneCurveIntersection(planeInter,baseCrv)
            tmpPt[0]=gh.ConstructPoint(tmpPt[0][1][0],tmpPt[0][1][1],0)
            tmpPt[1]=gh.ConstructPoint(tmpPt[1][1][0],tmpPt[1][1][1],0)
            tmpLine=gh.PolyLine(tmpPt,False)
            baseLines.append(tmpLine)
            baseH.append(4)
            basePlanes.append(planeRec)
        lenReamin=siteLen-(10+betweenLen)*(setNum-1)
        if lenReamin<35:
            baseLines=baseLines
        else:
            newH=int((lenReamin-10)/(dayFactor*4))
            planeInter=gh.ConstructPlane(disPt1,planeX,planeY)
            planeRec=gh.ConstructPlane(disPt1,planeX,planeZ)
            tmpPt=rs.PlaneCurveIntersection(planeInter,baseCrv)
            tmpPt[0]=gh.ConstructPoint(tmpPt[0][1][0],tmpPt[0][1][1],0)
            tmpPt[1]=gh.ConstructPoint(tmpPt[1][1][0],tmpPt[1][1][1],0)
            tmpLine=gh.PolyLine(tmpPt,False)
            baseLines.append(tmpLine)
            baseH.append(newH)
            basePlanes.append(planeRec)
        [BDs,area]=getBoxes(baseLines,baseH,basePlanes)
    return [BDs,area]

#根据阳光转一转的一系列
#角度到弧度
def getR(n):
    return math.pi/180*n
#旋转后并把点顺时针排列
def getRotatedPts(base, rotate):
    nakedPts=gh.Discontinuity(base,1)[0]
    cenPt=gh.Average(nakedPts)
    base=gh.Rotate(base,getR(rotate),gh.XYPlane(cenPt))[0]
    cenCircle=gh.Circle(cenPt,10)
    nakedPts=gh.SortAlongCurve(nakedPts,cenCircle)[0]
    nakedPts=gh.Rotate(nakedPts,getR(rotate),gh.XYPlane(cenPt))[0]
    return [nakedPts,cenPt]
#旋转后的边界矩形
def getSimpleBoundary(base, rotate):
    basePts=getRotatedPts(base, rotate)[0]
    if rotate>=0:
        pt0=gh.ConstructPoint(basePts[1].X,basePts[0].Y,0)
        pt1=gh.ConstructPoint(basePts[3].X,basePts[2].Y,0)
    else:
        pt0=gh.ConstructPoint(basePts[0].X,basePts[1].Y,0)
        pt1=gh.ConstructPoint(basePts[2].X,basePts[3].Y,0)
    tmp=gh.Rectangle2Pt(rs.WorldXYPlane(),pt0,pt1,0)[0]
    return tmp
#根据所输入三角形最大化放入篮球场地
def getBasketballField(pts):
    L01=gh.Distance(pts[0],pts[1])
    L12=gh.Distance(pts[2],pts[1])
    L20=gh.Distance(pts[0],pts[2])
    newPlane=gh.Plane3Pt(pts[2],pts[0],pts[1])
    vecX=gh.DeconstructPlane(newPlane)[1]
    vecY=gh.DeconstructPlane(newPlane)[2]
    triH=L01*L12/L20
    remainH=(1-32/L20)*triH
    row=int(remainH/19)
    tmp=[]
    if row>0:
        for i in range(row):
            remainL20=(triH-19*(i+1))/triH*L20
            col=int((remainL20)/32)
            for j in range(col):
                vecLenX=19*L12/L01*(i+1)+j*32
                moveX=vecX*vecLenX
                moveY=vecY*19*i
                recPt=gh.ConstructPoint(pts[2].X+moveX.X+moveY.X,pts[2].Y+moveX.Y+moveY.Y,0)
                recPlane=gh.ConstructPlane(recPt,vecX,vecY)
                tmp.append(gh.Rectangle(recPlane,32,19,0)[0])
    return tmp
#旋转角度大于0的情况 得出所需增加宽度
def getWidMoreMore(denSup,SNum,triPtSupSP,fieldNum,denSP,denOF,triPtOF):
    a=gh.Distance(triPtSupSP[0],triPtSupSP[1])
    b=gh.Distance(triPtSupSP[2],triPtSupSP[1])
    aOF=gh.Distance(triPtOF[0],triPtOF[1])
    bOF=gh.Distance(triPtOF[2],triPtOF[1])
    areaSup=denSup*SNum
    areaOF=denOF*SNum
    if fieldNum<=0:
        areaSP=denSP
    else:
        areaSP=fieldNum*denSP
    #体育馆比例
    protionSP=(areaSP/(areaSP+areaSup))**0.5
    areaSPNow=a*b*protionSP**2/2
    areaSupNow=a*b/2-areaSPNow
    areaOFNow=aOF*bOF/2
    areaSPNeed=areaSP-areaSPNow
    areaSupNeed=areaSup-areaSupNow
    areaOFNeed=areaOF-areaOFNow
    if areaSPNeed>0:
        widSP=areaSPNeed/(a*protionSP)
    else :
        widSP=0
    if areaSupNeed>0:
        widSup=areaSupNeed/(a*(1-protionSP))
    else :
        widSup=0
    if areaOFNeed>0:
        widOF=areaOFNeed/bOF
    else :
        widOF=0
    widMore=gh.Maximum(gh.Maximum(widSP,widSup),widOF)
    return [protionSP,widMore]
#旋转角度小于0的情况  得出所需增加宽度
def getWidMoreLess(denSup,SNum,triPtOFSP,fieldNum,denSP,denOF,triPtSup):
    a=gh.Distance(triPtOFSP[2],triPtOFSP[1])
    b=gh.Distance(triPtOFSP[0],triPtOFSP[1])
    aSup=gh.Distance(triPtSup[0],triPtSup[1])
    bSup=gh.Distance(triPtSup[2],triPtSup[1])
    areaSup=denSup*SNum
    areaOF=denOF*SNum
    if fieldNum<=0:
        areaSP=denSP
    else:
        areaSP=fieldNum*denSP
    #体育馆比例
    protionSP=(areaSP/(areaSP+areaOF))**0.5
    areaSPNow=a*b*protionSP**2/2
    areaOFNow=a*b/2-areaSPNow
    areaSupNow=aSup*bSup/2
    areaSPNeed=areaSP-areaSPNow
    areaSupNeed=areaSup-areaSupNow
    areaOFNeed=areaOF-areaOFNow
    if areaSPNeed>0:
        widSP=areaSPNeed/(a*protionSP)
    else :
        widSP=0
    if areaOFNeed>0:
        widOF=areaOFNeed/(a*(1-protionSP))
    else :
        widOF=0
    if areaSupNeed>0:
        widSup=areaSupNeed/bSup
    else :
        widSup=0
    widMore=gh.Maximum(gh.Maximum(widSP,widSup),widOF)
    return [protionSP,widMore]
#根据比例得到直线上的点
def getCrvPt(pts,portion):
    vec=gh.VectorXYZ(portion*(pts[1].X-pts[0].X),portion*(pts[1].Y-pts[0].Y),0)[0]
    tmp=gh.ConstructPoint(pts[0].X+vec.X,pts[0].Y+vec.Y,0)
    return tmp
#得到旋转后的操场/篮球场/体育馆/食堂/教师办公
def getPGRelated(base, rotate, SNum, denSup, denSP, feildNeed, denOF):
    boundaryCrv=getSimpleBoundary(base[0], rotate)
    boundaryPts=getBDPGPts(boundaryCrv)
    [basePts,cenPt]=getRotatedPts(base[0], rotate)
    field=[]
    PG=[]
    #得出旋转之后的操场
    for i in base:
        PG.append(gh.Rotate(i,getR(rotate),gh.XYPlane(cenPt))[0])
    #得出其他
    if rotate>=0:
        tri0=[basePts[3],boundaryPts[0],basePts[0]]
        tri1=[basePts[0],boundaryPts[1],basePts[1]]
        tri2=[basePts[1],boundaryPts[2],basePts[2]]
        tri3=[basePts[2],boundaryPts[3],basePts[3]]
        #得出最靠左边的篮球场
        field.append(getBasketballField(tri1))
        field.append(getBasketballField(tri2))
        fieldMore=0
        for i in field:
            fieldMore+=len(i)
        #算所需的扩展空间
        [portionSP,widMore]=getWidMoreMore(denSup,SNum,tri0,feildNeed-fieldMore,denSP,denOF,tri3)
        tmpL0=gh.Line(tri0[0],tri0[1])
        tmpL1=gh.Line(tri0[0],tri0[2])
        midPt0=getCrvPt(tmpL0,portionSP)
        midPt1=getCrvPt(tmpL1,portionSP)
        if widMore==0:
            #得出食堂
            BDSup=gh.PolyLine([midPt0,tri0[1],tri0[2],midPt1],True)
            BDSup=gh.OffsetCurve(BDSup,-2,rs.WorldXYPlane(),1)
            #得出体育馆
            BDSP=gh.PolyLine([tri0[0],midPt0,midPt1],True)
            BDSP=gh.OffsetCurve(BDSP,-2,rs.WorldXYPlane(),1)
            #得出办公
            BDOF=gh.PolyLine(tri3,True)
            BDOF=gh.OffsetCurve(BDOF,-2,rs.WorldXYPlane(),1)
        else:
            morePt0=gh.ConstructPoint(tri0[0].X+widMore,tri0[0].Y,0)
            morePt1=gh.ConstructPoint(tri0[1].X+widMore,tri0[1].Y,0)
            midPt2=gh.ConstructPoint(midPt0.X+widMore,midPt0.Y,0)
            #得出食堂
            BDSup=gh.PolyLine([midPt2,morePt1,tri0[2],midPt1],True)
            BDSup=gh.OffsetCurve(BDSup,-2,rs.WorldXYPlane(),1)
            #得出体育馆
            BDSP=gh.PolyLine([morePt0,midPt2,midPt1,tri0[0]],True)
            BDSP=gh.OffsetCurve(BDSP,-2,rs.WorldXYPlane(),1)
            #得出教师办公
            OFPt0=gh.ConstructPoint(tri3[1].X+widMore,tri3[1].Y,0)
            OFPt1=gh.ConstructPoint(tri3[2].X+widMore,tri3[2].Y,0)
            BDOF=gh.PolyLine([OFPt0,OFPt1,tri3[2],tri3[0]],True)
            BDOF=gh.OffsetCurve(BDOF,-2,rs.WorldXYPlane(),1)
    else:
        tri0=[basePts[0],boundaryPts[0],basePts[1]]
        tri1=[basePts[1],boundaryPts[1],basePts[2]]
        tri2=[basePts[2],boundaryPts[2],basePts[3]]
        tri3=[basePts[3],boundaryPts[3],basePts[0]]
        field.append(getBasketballField(tri1))
        field.append(getBasketballField(tri2))
        fieldMore=0
        for i in field:
            fieldMore+=len(i)
        #算所需的扩展空间
        [portionSP,widMore]=getWidMoreLess(denSup,SNum,tri3,feildNeed-fieldMore,denSP,denOF,tri0)
        tmpL0=gh.Line(tri3[2],tri3[1])
        tmpL1=gh.Line(tri3[2],tri3[0])
        midPt0=getCrvPt(tmpL0,portionSP)
        midPt1=getCrvPt(tmpL1,portionSP)
        if widMore==0:
            #得出办公
            BDOF=gh.PolyLine([midPt0,midPt1,tri3[0],tri3[1]],True)
            BDOF=gh.OffsetCurve(BDOF,-2,rs.WorldXYPlane(),1)
            #得出体育馆
            BDSP=gh.PolyLine([tri3[2],midPt0,midPt1],True)
            BDSP=gh.OffsetCurve(BDSP,-2,rs.WorldXYPlane(),1)
            #得出食堂
            BDSup=gh.PolyLine(tri0,True)
            BDSup=gh.OffsetCurve(BDSup,-2,rs.WorldXYPlane(),1)
        else:
            morePt0=gh.ConstructPoint(tri3[1].X+widMore,tri3[1].Y,0)
            morePt1=gh.ConstructPoint(tri3[2].X+widMore,tri3[2].Y,0)
            midPt2=gh.ConstructPoint(midPt0.X+widMore,midPt0.Y,0)
            #得出办公
            BDOF=gh.PolyLine([midPt2,midPt1,tri3[0],morePt0],True)
            BDOF=gh.OffsetCurve(BDOF,-2,rs.WorldXYPlane(),1)
            #得出体育馆
            BDSP=gh.PolyLine([midPt2,morePt1,tri3[2],midPt1],True)
            BDSP=gh.OffsetCurve(BDSP,-2,rs.WorldXYPlane(),1)
            #得出食堂
            SupPt0=gh.ConstructPoint(tri0[0].X+widMore,tri0[0].Y,0)
            SupPt1=gh.ConstructPoint(tri0[1].X+widMore,tri0[1].Y,0)
            BDSup=gh.PolyLine([SupPt0,SupPt1,tri0[2],tri0[0]],True)
            BDSup=gh.OffsetCurve(BDSup,-2,rs.WorldXYPlane(),1)
    threshold=[]
    threshold.append(gh.Distance(boundaryPts[0],boundaryPts[1])+widMore)
    threshold.append(gh.Distance(boundaryPts[2],boundaryPts[1]))
    return [PG, field, BDSup,BDSP,BDOF,threshold,boundaryPts]

#得到所有的地块图形
def getPGType(BDAllPt, PGGraph, dayFactor, denBD, denSup, denSP, denOF, feildNeed, rotate, SNum):
    #先看操场及其相关能不能放得下
    widBDAll=gh.Length(gh.Line(BDAllPt[0],BDAllPt[1]))
    lenBDAll=gh.Length(gh.Line(BDAllPt[2],BDAllPt[1]))
    [PG, PGfield, BDSup,BDSP,BDOF,thresholdValue,boundaryPts]=getPGRelated(PGGraph, rotate, SNum, denSup, denSP, feildNeed,denOF)
    bigBetween=5
    
    if widBDAll>=thresholdValue[0] and lenBDAll>=thresholdValue[1]:
        moveX=thresholdValue[0]
        moveY=thresholdValue[1]
    else:
        print '该场地无法放置满足条件的操场'
        return 0
    #两种情况看剩余功能怎么分布
    #第一种操场加疏散的情况
    if moveX*(lenBDAll-moveY-2-2-2)>=500:
        #得出操场 食堂 篮球场 体育场 办公
        vecMove=gh.VectorXYZ(BDAllPt[1].X+2-boundaryPts[1].X,BDAllPt[1].Y-2-boundaryPts[1].Y,0)[0]
        PG=gh.Move(PG,vecMove)[0]
        BDSup=gh.Move(BDSup,vecMove)[0]
        BDSP=gh.Move(BDSP,vecMove)[0]
        BDOF=gh.Move(BDOF,vecMove)[0]
        for i in range(len(PGfield)):
            PGfield[i]=gh.Move(PGfield[i],vecMove)[0]
        #得出疏散广场
        lenSQ=lenBDAll-moveY-2-2-2
        widSQ=moveX
        recPtSQ=gh.ConstructPoint(BDAllPt[2].X+2,BDAllPt[2].Y+2,0)
        FSQ=gh.Rectangle(recPtSQ,widSQ,lenSQ,0)[0]
        #再算教学楼区域
        BDPt=gh.ConstructPoint(BDAllPt[1].X+2+moveX+bigBetween,BDAllPt[2].Y+2,0)
        BDoutline=gh.Rectangle(BDPt,widBDAll-2-moveX-bigBetween-2,lenBDAll-2-2,0)[0]
        [BDs,areaBDNow]=getBDs(rotate,dayFactor,BDoutline)
        areaBDRe=denBD*SNum
        if areaBDNow>=areaBDRe:
            BDs=BDs
        else :
            print '该场地无法放置满足条件的教学楼'
            return 0
            
    #第二种操场加疏散的情况
    else:
        #得出操场 食堂 篮球场 体育场 教师办公
        vecMove=gh.VectorXYZ(BDAllPt[1].X+2-boundaryPts[1].X,BDAllPt[1].Y-2-boundaryPts[1].Y,0)[0]
        PG=gh.Move(PG,vecMove)[0]
        BDSup=gh.Move(BDSup,vecMove)[0]
        BDSP=gh.Move(BDSP,vecMove)[0]
        BDOF=gh.Move(BDOF,vecMove)[0]
        for i in range(len(PGfield)):
            PGfield[i]=gh.Move(PGfield[i],vecMove)[0]
        #得出疏散广场
        widSQ=widBDAll-moveX-2-bigBetween-2
        lenSQ=(500.0)/(widSQ)
        recPtSQ=gh.ConstructPoint(BDAllPt[2].X+2+moveX+bigBetween,BDAllPt[2].Y+2,0)
        FSQ=gh.Rectangle(recPtSQ,widSQ,lenSQ,0)[0]
        #再算教学区域
        BDPt=gh.ConstructPoint(BDAllPt[1].X+2+moveX+bigBetween,BDAllPt[2].Y+2+lenSQ+2,0)
        BDoutline=gh.Rectangle(BDPt,widBDAll-2-moveX-bigBetween-2,lenBDAll-2-2-2-lenSQ,0)[0]
        [BDs,areaBDNow]=getBDs(rotate,dayFactor,BDoutline)
        areaBDRe=denBD*SNum
        if areaBDNow>=areaBDRe:
            BDs=BDs
        else :
            print '该场地无法放置满足条件的教学楼'
            return 0
        
    
    return [PG,PGfield,BDSup,BDSP,FSQ,BDOF,BDs]

SType=getSType(SNum)
#先转一下所有的操场
"""BDPG18=getBoundary(rotate,BDPG18)
BDPG24=getBoundary(rotate,BDPG24)
BDPG36=getBoundary(rotate,BDPG36)"""


if abs(rotate)>10:
    if SType==0:
        [PG,PGfield,BDSup,BDSP,FSQ,BDOF,BDs]=getPGType(Boundary,BDPG18,dayFactor,7.5,1.2,1000,0.79,0,rotate,SNum)
    elif SType==1:
        [PG,PGfield,BDSup,BDSP,FSQ,BDOF,BDs]=getPGType(Boundary,BDPG24,dayFactor,7.3,1.2,1000,0.74,4,rotate,SNum)
    elif SType==2:
        [PG,PGfield,BDSup,BDSP,FSQ,BDOF,BDs]=getPGType(Boundary,BDPG24,dayFactor,7.0,1.2,1000,0.69,4,rotate,SNum)
    else:
        [PG,PGfield,BDSup,BDSP,FSQ,BDOF,BDs]=getPGType(Boundary,BDPG36,dayFactor,6.7,1.2,1000,0.66,6,rotate,SNum)
# ---------- end python_3 ----------
python_4 = GhPythonScript(
    SNum=snum,
    Boundary=alongcrv.Points,
    BDPG18=entwine,
    BDPG24=entwine_2,
    BDPG36=entwine_3,
    dayFactor=number_slider,
    rotate=number_slider_2)  # -> out, SType, PG, FSQ, BDs, BDSup, BDSP, BDOF; inputs SNum: Int32, Boundary: list of Point3d, BDPG18: tree of Curve, BDPG24: tree of Curve, BDPG36: tree of Curve
# ---------- python_4: Python ----------
__author__ = "46314"
__version__ = "2021.11.03"

import random
import math
import rhinoscriptsyntax as rs
import Rhino.Geometry as rg
import ghpythonlib.components as gh
import clr
clr.AddReference("Grasshopper")
from Grasshopper.Kernel.Data import GH_Path
from Grasshopper import DataTree

#看学校是多少人多少班
def getSType(num):
    tmp=0
    if num<=45*24:
        tmp=0
    elif 45*24<num<=45*30:
        tmp=1
    elif 45*30<num<=45*36:
        tmp=2
    else:
        tmp=3
    return tmp

#把点的列表按顺时针顺序排序
def getBDPGPts(BDPG):
    nakedPts=gh.Discontinuity(BDPG,1)[0]
    cenPt=gh.Average(nakedPts)
    cenCircle=gh.Circle(cenPt,10)
    tmp=gh.SortAlongCurve(nakedPts,cenCircle)[0]
    return tmp

#得到每一组操场里的外框的长和宽
def getThreshold(PGGraph):
    tmp=[]
    for i in range(PGGraph.BranchCount):
        tt=[]
        tmpPts=getBDPGPts(PGGraph.Branch(i)[0])
        tt.append(gh.Length(gh.Line(tmpPts[0],tmpPts[1])))
        tt.append(gh.Length(gh.Line(tmpPts[2],tmpPts[1])))
        tmp.append(tt)
    return tmp

#以中心点画矩形
def getRecFromCen(Pt, X, Y):
    tmp=gh.Rectangle(Pt,X,Y,0)[0]
    tmpVec=gh.VectorXYZ(-X/2.0,-Y/2.0,0)[0]
    tmp=gh.Move(tmp,tmpVec)[0]
    return tmp

#教学区图形绘制相关
def getHowmanySetsofBuilding(dayFactor, siteLen):
    betweenLen=4*4*dayFactor
    if betweenLen>=25:
        betweenLen=betweenLen
    else:
        betweenLen=25
    n=int((siteLen+betweenLen)/(10+betweenLen))
    return n
#教学楼底层矩形
def getBaseRec(dayFactor, Outline):
    betweenLen=4*4*dayFactor
    PtOutline=getBDPGPts(Outline)
    siteLen=gh.Distance(PtOutline[1],PtOutline[2])
    if betweenLen>=25:
        betweenLen=betweenLen
    else:
        betweenLen=25
    tmp=[]
    tmpH=[]
    Num=getHowmanySetsofBuilding(dayFactor, siteLen)
    Boundary=getBDPGPts(Outline)
    for i in range(Num):
        tmpCen=gh.Average([Boundary[1],Boundary[0]])
        cenPt=gh.ConstructPoint(tmpCen.X,tmpCen.Y-5-i*(betweenLen+10),0)
        tt=getRecFromCen(cenPt,gh.Distance(Boundary[1],Boundary[0]),10)
        #tt=gh.Rectangle(cenPt,gh.Distance(Boundary[1],Boundary[0]),10,0)[0]
        tmp.append(tt)
        tmpH.append(4)
    lenRemain=siteLen-10*Num-(Num-1)*betweenLen
    sidePt=gh.ConstructPoint(PtOutline[3].X-10,PtOutline[3].Y,0)
    tmp.append(gh.Rectangle(sidePt,10,siteLen,0)[0])
    tmpH.append(4)
    if lenRemain<35:
        return [tmp,tmpH]
    else:
        newH=int((lenRemain-10)/(dayFactor*4))
        tmpH.append(newH)
        tmp.append(gh.Rectangle(Boundary[2],gh.Distance(Boundary[2],Boundary[3]),10,0)[0])
        return [tmp,tmpH]
#教学楼box
def getBuildingBox(dayFactor, Outline):
    baseRecs=getBaseRec(dayFactor,Outline)[0]
    baseHs=getBaseRec(dayFactor, Outline)[1]
    tmpBox=[]
    areaBD=0
    for i in range(len(baseRecs)):
        Pts=getBDPGPts(baseRecs[i])
        tt=gh.ConstructPoint(Pts[0].X,Pts[0].Y,baseHs[i]*4)
        tmp=gh.Box2Pt(Pts[2],tt,gh.XYPlane(gh.ConstructPoint(0,0,0)))
        tmpBox.append(tmp)
        areaBD+=gh.Area(baseRecs[i])[0]*(baseHs[i])
    return [tmpBox,areaBD]

#角度到弧度
def getR(n):
    return math.pi/180*n
#先根据阳光把操场转一下
def getBoundary(rotate, BDPG18):
    for i in range(BDPG18.BranchCount):
        for j in range(len(BDPG18.Branch(i))):
            BDPG18.Branch(i)[j]=gh.Rotate(BDPG18.Branch(i)[j],getR(rotate),rs.WorldXYPlane())[0]
    tmpBox=gh.BoundingBox(BDPG18.Branch(0)[0],rs.WorldXYPlane())[0]
    tmpRec=gh.Rectangle(gh.DeconstructBox(tmpBox)[0],gh.DeconstructBox(tmpBox)[1],gh.DeconstructBox(tmpBox)[2],gh.DeconstructBox(tmpBox)[3])[0]
    BDPG18.Branch(0)[0]=tmpRec
    tmpBox=gh.BoundingBox(BDPG18.Branch(1)[0],rs.WorldXYPlane())[0]
    tmpRec=gh.Rectangle(gh.DeconstructBox(tmpBox)[0],gh.DeconstructBox(tmpBox)[1],gh.DeconstructBox(tmpBox)[2],gh.DeconstructBox(tmpBox)[3])[0]
    BDPG18.Branch(1)[0]=tmpRec
    return BDPG18

#得到所有的地块图形
def getPGType(BDAllPt, PGGraph, dayFactor, denBD, denSup, denSP, denOF):
    BDSP=0
    BDOF=0
    #先看操场
    widBDAll=gh.Length(gh.Line(BDAllPt[0],BDAllPt[1]))
    lenBDAll=gh.Length(gh.Line(BDAllPt[2],BDAllPt[1]))
    thresholdValue=getThreshold(PGGraph)
    bigBetween=5
    
    if widBDAll>=thresholdValue[0][0] and lenBDAll>=thresholdValue[0][1]:
        PGType=PGGraph.Branch(0)
        moveX=thresholdValue[0][0]
        moveY=thresholdValue[0][1]
    elif thresholdValue[1][1]<lenBDAll<=thresholdValue[0][1] and widBDAll>=thresholdValue[1][0]:
        PGType=PGGraph.Branch(1)
        moveX=thresholdValue[1][0]
        moveY=thresholdValue[1][1]
    else:
        print '该场地无法放置满足条件的操场'
        return 0
        
    #再看500平的疏散广场和教师办公
    #教师办公面积
    areaBDOF=denOF*SNum
    
    #第一种操场加疏散的情况
    if (moveX-2)*(lenBDAll-moveY-2-2-2)>=(500+areaBDOF):
        #得出操场
        tarPt=gh.VectorXYZ((BDAllPt[2].X+BDAllPt[1].X)/2.0+moveX/2.0+2,(BDAllPt[1].Y+BDAllPt[0].Y)/2.0-moveY/2.0-2.0,0)[0]
        PGType=gh.Move(PGType,tarPt)[0]
        #得出疏散广场
        lenSQOF=lenBDAll-moveY-2-2-2
        widSQ=500.0/lenSQOF
        recPtSQ=gh.ConstructPoint(BDAllPt[2].X+2,BDAllPt[2].Y+2,0)
        FSQ=gh.Rectangle(recPtSQ,widSQ,lenSQOF,0)[0]
        #再算教师办公
        widOF=moveX-2-widSQ
        recPtOF=gh.ConstructPoint(BDAllPt[2].X+2+2+widSQ,BDAllPt[2].Y+2,0)
        BDOF=gh.Rectangle(recPtOF,widOF,lenSQOF,0)[0]
        #生活服务用房加体育馆
        areaSup=denSup*SNum
        areaSP=denSP*1
        widSupplusSP=widBDAll-2-moveX-bigBetween-2
        if widSupplusSP*20>=(areaSup+areaSP):
            #先算生活服务用房
            lenSupSP=20.0
            widSup=areaSup/lenSupSP
            recPtSup=gh.ConstructPoint(BDAllPt[0].X-2,BDAllPt[0].Y-2,0)
            BDSup=gh.Rectangle(recPtSup,-widSup,-lenSupSP,0)[0]
            #再算体育馆
            widSP=widSupplusSP-2-widSup
            recPtSP=gh.ConstructPoint(BDAllPt[1].X+2+moveX+bigBetween,BDAllPt[1].Y-2-lenSupSP,0)
            BDSP=gh.Rectangle(recPtSP,widSP,lenSupSP,0)[0]
        else:
            #先算生活服务
            lenSupSP=(areaSup+areaSP)/widSupplusSP
            widSup=areaSup/lenSupSP
            recPtSup=gh.ConstructPoint(BDAllPt[0].X-2,BDAllPt[0].Y-2,0)
            BDSup=gh.Rectangle(recPtSup,-widSup,-lenSupSP,0)[0]
            #再看体育馆
            widSP=widSupplusSP-2-widSup
            recPtSP=gh.ConstructPoint(BDAllPt[1].X+2+moveX+bigBetween,BDAllPt[1].Y-2-lenSupSP,0)
            BDSP=gh.Rectangle(recPtSP,widSP,lenSupSP,0)[0]
        #再算教学楼区域
        BDPt=gh.ConstructPoint(BDAllPt[1].X+2+moveX+bigBetween,BDAllPt[2].Y+2,0)
        BDoutline=gh.Rectangle(BDPt,widSupplusSP,lenBDAll-2-lenSupSP-25-2,0)[0]
        BDs=[]
        areaBDRe=denBD*SNum
        areaBDNow=getBuildingBox(dayFactor,BDoutline)[1]
        if areaBDNow>=areaBDRe:
            BDs=getBuildingBox(dayFactor,BDoutline)[0]
            BDs.append(BDoutline)
        else :
            print '该场地无法放置满足条件的教学楼'
            return 0
            
    #第二种操场加疏散的情况
    else:
        #得出操场
        tarPt=gh.VectorXYZ((BDAllPt[2].X+BDAllPt[1].X)/2.0+moveX/2.0+2,(BDAllPt[1].Y+BDAllPt[2].Y)/2.0,0)[0]
        PGType=gh.Move(PGType,tarPt)[0]
        #得出各部分面积要求，中间2m间距
        areaSup=denSup*SNum
        areaSP=denSP*1
        areaOF=denOF*SNum
        #算出所需宽度
        lenSupplusSQ=lenBDAll-2-2-2-2-2
        widSupSQ=(areaSup+500+areaSP+areaOF)/(lenSupplusSQ)
        #得出各部分所需长度
        lenSQ=500/widSupSQ
        lenOF=areaOF/widSupSQ
        lenSP=areaSP/widSupSQ
        lenSup=areaSup/widSupSQ
        #得出广场图形
        SQPt=gh.ConstructPoint(BDAllPt[2].X+2+bigBetween+moveX,BDAllPt[2].Y+2,0)
        FSQ=gh.Rectangle(SQPt,widSupSQ,lenSQ,0)[0]
        #得出教师办公
        recPtOF=gh.ConstructPoint(SQPt.X,SQPt.Y+lenSQ+2,0)
        BDOF=gh.Rectangle(recPtOF,widSupSQ,lenOF,0)[0]
        #得出体育馆
        recPtSP=gh.ConstructPoint(SQPt.X,recPtOF.Y+lenOF+2,0)
        BDSP=gh.Rectangle(recPtSP,widSupSQ,lenSP,0)[0]
        #得出食堂图形
        recPtSup=gh.ConstructPoint(SQPt.X,recPtSP.Y+lenSP+2,0)
        BDSup=gh.Rectangle(recPtSup,widSupSQ,lenSup,0)[0]
        #再算教学区域
        BDPt=gh.ConstructPoint(SQPt.X+bigBetween+widSupSQ,SQPt.Y,0)
        widBD=widBDAll-2-moveX-bigBetween-widSupSQ-bigBetween
        lenBD=lenBDAll-2-2
        BDoutline=gh.Rectangle(BDPt,widBD,lenBD,0)[0]
        BDs=[]
        areaBDRe=denBD*SNum
        areaBDNow=getBuildingBox(dayFactor,BDoutline)[1]
        if areaBDNow>=areaBDRe:
            BDs=getBuildingBox(dayFactor,BDoutline)[0]
            BDs.append(BDoutline)
        else :
            print '该场地无法放置满足条件的教学楼'
            return 0
        
    
    return [PGType,FSQ,BDs,BDSup,BDSP,BDOF]





SType=getSType(SNum)
#先转一下所有的操场
BDPG18=getBoundary(rotate,BDPG18)
BDPG24=getBoundary(rotate,BDPG24)
BDPG36=getBoundary(rotate,BDPG36)

if abs(rotate)<=10:
    if SType==0:
        [PG,FSQ,BDs,BDSup,BDSP,BDOF]=getPGType(Boundary,BDPG18,dayFactor,7.5,1.2,1000,0.79)
    elif SType==1:
        [PG,FSQ,BDs,BDSup,BDSP,BDOF]=getPGType(Boundary,BDPG24,dayFactor,7.3,1.2,1000,0.74)
    elif SType==2:
        [PG,FSQ,BDs,BDSup,BDSP,BDOF]=getPGType(Boundary,BDPG24,dayFactor,7.0,1.2,1000,0.69)
    else:
        [PG,FSQ,BDs,BDSup,BDSP,BDOF]=getPGType(Boundary,BDPG36,dayFactor,6.7,1.2,1000,0.66)
# ---------- end python_4 ----------
crv_15 = Curve([<curve referenced from the Rhino model> x71])
crv_16 = Curve([<curve referenced from the Rhino model> x45])
crv_17 = Curve([<curve referenced from the Rhino model> x35])
merge = Merge(Data1=crv_12, Data2=crv_13)
item = ListItem(List=crv_15, Index=0, Wrap=True)
item_2 = ListItem(List=crv_16, Index=0, Wrap=True)
item_3 = ListItem(List=crv_17, Index=0, Wrap=True)

crv_18 = Curve(python_4.PG)
crv_19 = Curve(python_4.FSQ)
crv_20 = Curve(python_4.BDSup)
crv_21 = Curve(python_4.BDSP)
crv_22 = Curve(python_4.BDOF)
geo_3 = Geometry(python_4.BDs)

area_2 = Area(Geometry=merge)  # -> Area, Centroid
panel_2 = Panel(python_4.out)
number_slider_3 = Slider(6, range=0..10)
panel_3 = Panel("""疏散广场
生活服务用房""")
merge_2 = Merge(Data1=crv_19, Data2=crv_20, Data3=crv_21, Data4=crv_22)
area_3 = Area(Geometry=merge_2)  # -> Area, Centroid
xy = XYPlane(Origin=area_3.Centroid)
tag = TextTag3D(Location=simplify(graft(area_2.Centroid)), Text=simplify(graft(panel_3)), Size=number_slider_3, Justification=5)
deplane = DeconstructPlane(Plane=xy)  # -> Origin, XAxis, YAxis, ZAxis
pl = ConstructPlane(Origin=deplane.Origin, XAxis=deplane.YAxis, YAxis=expr("-1*x", deplane.XAxis))
tag_2 = TextTag3D(Location=simplify(graft(pl)), Text=simplify(graft(panel_3)), Size=number_slider_3, Justification=5)
