# Grasshopper definition Example.gh (Grasshopper 1.0.7)
# plug-ins: TJADSZY

genes = GenePool(
    Decimals=2,
    Maximum=100,
    Minimum=0,
    Value=[9.19, 28.59, 35.28, 58.7, 17.89, 47.17, 21.23, 30.6, 60.03, 36.62, 66.06, 9.82, 84.78, 18.6, 32.67, 21.88])
line = Line([Line((225.4801349, -87.38323311, 0), (144.8743219, -23.69468952, 0)), Line((225.4801349, -87.38323311, 0), (227.4704019, -19.71415554, 0)), Line((225.4801349, -87.38323311, 0), (292.154079, -27.67522349, 0)), Line((144.8743219, -23.69468952, 0), (179.7039942, 48.95005552, 0)), Line((227.4704019, -19.71415554, 0), (179.7039942, 48.95005552, 0)), Line((227.4704019, -19.71415554, 0), (255.3341397, 60.89165745, 0))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])
nf = NetworkFLow(InputEdges=line, InputCapacity=genes)  # -> OutputMaxFlow, OutputPlane, OutputEdgeInfo
panel = Panel(nf.OutputMaxFlow)
tag = TextTag3D(Location=nf.OutputPlane, Text=nf.OutputEdgeInfo, Size=Slider(4, range=0..10), Justification=5)
