# Grasshopper definition package.gh (Grasshopper 1.0.7)
# plug-ins: TJADSZY

pt = Point([Point(-30.96333996, 8.41180891, 0), Point(-16.29803144, -2.51165876, 0), Point(0.01293308443, -10.72014536, 0), Point(17.96898396, -12.1691082, 0), Point(32.2129241, -1.155369823, 0), Point(42.24575366, 14.13495223, 0)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])
intcrv = Interpolate(Vertices=pt, Degree=3, Periodic=False, KnotStyle=1)  # -> Curve, Length, Domain
gaw = GraphAsWish(InputCrv=intcrv.Curve, InputNumber=Slider(20, range=0..100))

pt_2 = Point([Point(146.3339712, 327.0581933, 0), Point(279.3670425, 413.0077764, 0), Point(477.4189984, 335.0553247, 0), Point(684.9572399, 284.6937125, 0), Point(854.3019868, 361.8218586, 0), Point(1007.057133, 241.2967967, 0)])
pt_3 = Point([Point(146.3339712, 413.6979124, 254.9845236), Point(301.0060152, 358.7851509, 254.9845236), Point(468.8414574, 403.979512, 254.9845236), Point(659.6791561, 444.9065215, 254.9845236), Point(882.4527231, 391.0408589, 254.9845236), Point(1007.057133, 464.6387454, 254.9845236)])
pt_4 = Point([Point(0.5, -0.5, 0), Point(-0.5, -0.5, 0), Point(-0.5, 0.5, 0), Point(0.5, 0.5, 0)])
pline = PolyLine(Vertices=pt_4, Closed=invert(False))
intcrv_2 = Interpolate(Vertices=pt_2, Degree=3, Periodic=False, KnotStyle=1)  # -> Curve, Length, Domain
intcrv_3 = Interpolate(Vertices=pt_3, Degree=3, Periodic=False, KnotStyle=1)  # -> Curve, Length, Domain
merge = Merge(Data1=intcrv_2.Curve, Data2=intcrv_3.Curve)
pt_5 = Point(Point(0, 0, 0))
hr = HandRail(
    InputRail=merge,
    InputCount=Slider(15, range=0..100),
    InputHeight=Slider(30, range=0..100),
    InputSection=pline,
    InputLocation=pt_5)
