# Grasshopper definition test.gh (Grasshopper 1.0.7)
# plug-ins: TJADSZY

panel = Panel("""装修区域
房间
分部分项工程
明细
单位
正式工程量
工程量""")
panel_2 = Panel("""站房部分
出站地道
架空换乘区
室外平台
高架层底面吊顶
铁路停车场""")
button = Button()
path = FilePath("E:\00LetsGo\08Study\02C#GH\02Plugin\TJAD\TJAD\test.xlsx")
number_slider = Slider(1, range=0..1)
nickname = TJADSZY(
    Run=Toggle(False),
    FilePath=path,
    StartCellIndex="A1",
    TitleNames=panel,
    WorkSheetNames=panel_2,
    ModGlassWall=number_slider,
    ModOtherWall=number_slider,
    ModCeiling=number_slider,
    ModCeilingSide=number_slider,
    ModForDM=number_slider,
    ModHandles=number_slider)
panel_3 = Panel(nickname)
c_script = CSharpScript()  # -> out, A, B, C; inputs x: String
# ---------- c_script: C# ----------
    A = (x == "平方米\r");
    B = x;
    C = x.Length;
# ---------- end c_script ----------
panel_4 = Panel(c_script.A)
panel_5 = Panel(c_script.C)
panel_6 = Panel(c_script.B)
